# Dynamo graph Average_Grade_Plane_Calculation.dyn (Dynamo 2.0.1.5055)

run = BoolSelector(true)
TOPO = DSModelElementSelection()  # 1 picked in the model; graph input
points = Topography.Points(topography=TOPO)
PAD = DSFaceSelection()  # 1 picked in the model; graph input
perimeterCurves = Surface.PerimeterCurves(surface=PAD)
startPoint = Curve.StartPoint(curve=perimeterCurves)
flatten = List.Flatten(list=startPoint)
PAD_2 = DSFaceSelection()  # 1 picked in the model; graph input
perimeterCurves_2 = Surface.PerimeterCurves(surface=PAD_2)
startPoint_2 = Curve.StartPoint(curve=perimeterCurves_2)
flatten_2 = List.Flatten(list=startPoint_2)
perpendicular_Distance = DoubleInput(10)
resolution_Distance = DoubleInput(1)
gradingtool = Python(IN[0]=run, IN[1]=points, IN[2]=flatten, IN[3]=flatten_2, IN[4]=perpendicular_Distance, IN[5]=resolution_Distance)
# ---------- gradingtool.python (262 lines) ----------
# Enable Python support and load DesignScript library
import clr
clr.AddReference('ProtoGeometry')
from Autodesk.DesignScript.Geometry import *
clr.AddReference('RevitAPI') #import clr
from Autodesk.Revit.DB import *

import sys
reload(sys)
sys.setdefaultencoding('utf-8')
sys.path.append(r"C:\Program Files (x86)\IronPython 2.7\Lib")
sys.path = sorted(sys.path, key=lambda p: p.find("Python27"))

import math
import uuid
import cPickle
import zipfile
import os
import subprocess
import getpass
import System

try:
    System.Net.ServicePointManager.SecurityProtocol = System.Net.SecurityProtocolType.Tls12
except AttributeError:
    # TLS 1.2 not provided by MacOS .NET Core; revert to using TLS 1.0
    System.Net.ServicePointManager.SecurityProtocol = System.Net.SecurityProtocolType.Tls


def download_file(url, targetDirectory):
    print targetDirectory
    localFilePath = os.path.join(targetDirectory, os.path.basename(url))
    client = System.Net.WebClient()
    client.DownloadFile(url, localFilePath)
    return localFilePath

def check_or_make_directory(dir_path):
    if not os.path.isdir(dir_path):
        try:
            os.mkdir(dir_path)
        except:
            raise Exception("Folder can't be constructed: '{}' can't be made.".format(dir_path))

def unzip_file(zipFile, targetDirectory):
    with zipfile.ZipFile(zipFile) as zf:
        for f in zf.namelist():
            if f.endswith('/'):
                try: os.makedirs(f)
                except: pass
            else:
                zf.extract(f, targetDirectory)

def del_directory(dir, rmdir = True):
    try:
        if dir[-1] == os.sep: dir = dir[:-1]
        files = os.listdir(dir)
        for file in files:
            if file == '.' or file == '..': continue
            path = dir + os.sep + file
            if os.path.isdir(path):
                del_directory(path)
            else:
                os.unlink(path)
        if rmdir: os.rmdir(dir)
    except:
        print "Delete old directory failed"

def set_directory_structure(update_tool, cache_dir_parent, pkg_name, url):
    """
    Makes directory to store cache files if it doesn't exist.
    Copies python package over from git.
    """

    # cache directory
    cache_dir = r"kt_cpython_cache"
    cache_path = os.path.join(cache_dir_parent, cache_dir)

    # pkg directory
    pkg_parent_path = os.path.join(cache_path, pkg_name)
    pkg_path = os.path.join(pkg_parent_path, pkg_name + "-master")

    # if package exists
    if os.path.isdir(pkg_path):
        # delete pkg_path if you want to update
        if update_tool:
            del_directory(pkg_parent_path, rmdir = True)
            print "Deleting ", pkg_path
    # Check again if package doesn't exists, download from repo
    if not os.path.isdir(pkg_path):
        # cache directory
        check_or_make_directory(cache_path)
        # pacakge parent directory
        check_or_make_directory(pkg_parent_path)
        # download pkg zip
        zip_file_path = download_file(url, pkg_parent_path)
        print "Downloading the source code..."
        # unzip pkg
        unzip_file(zip_file_path, pkg_parent_path)
        print "Downloaded!"
    return pkg_path

def run_python_process(p, program, argument, working_directory):
    argstr = ""
    print program
    print argument
    print working_directory
    PIPE = subprocess.PIPE
    STDOUT = subprocess.STDOUT
    p = subprocess.Popen([program, argument, argstr], cwd=working_directory, shell=True, stdin=PIPE, stdout=PIPE, stderr=STDOUT)
    #print p.communicate()
    script_output = p.stdout.read()
    streamdata = p.communicate()[0] # need this to make sure process has finished
    exitcode = p.returncode

    if exitcode != 0:
        print "Command failed with return code", exitcode

    #script_output = program + argument + working_directory

    return p, script_output, exitcode

def send_to_pickle(znames_, aval_dict_, apts_mtx_, exp_, param_, cache_dir_):

    exp_run_name = experiment_run_name(exp_, param_)

    for i,apts_in_zone in enumerate(apts_mtx_):

        for j,apt in enumerate(apts_in_zone):
            apt = rs.coerce3dpoint(apt)
            apts_mtx_[i][j] = [apt[0],apt[1],apt[2]]

    #print(apts_mtx_[-1])
    #print(len(apts_mtx_[-1]))

    pkl_mtx = [znames_, apts_mtx_, aval_dict_]

    return pickle(pkl_mtx, cache_dir_, exp_run_name + ".pkl")

def pickle(data, cpickle_path, cpickle_name):
    pkl_file_path = os.path.join(cpickle_path, cpickle_name)

    # Pickle objects, protocol 1 b/c binary file
    with open(pkl_file_path, "wb") as outf:
        cPickle.dump(data, outf)

    return pkl_file_path

def unpickle(pkl_file_path):
    """ Read non-binary picle """
    with open(pkl_file_path, "r") as inf:
        unpickled_object = cPickle.load(inf)
        return unpickled_object

def rvt2py(rhpt):
    if isinstance(rhpt, (list,tuple)):
        rhpt_lst = rhpt
        return [(rhpt.X, rhpt.Y, rhpt.Z) for rhpt in rhpt_lst]
    else:
        return (rhpt.X, rhpt.Y, rhpt.Z)

def py2rvt(pypt):
    if isinstance(pypt, (list,tuple)):
        pypt_lst = pypt
        return [XYZ(pypt[0],pypt[1],pypt[2]) for pypt in pypt_lst]
    else:
        return XYZ(pypt[0],pypt[1],pypt[2])


def main(p, topo_pts, topo_crv, bldg_crv, anaconda_path, perpendicular_dist, spacing_dist, update_tool = False):
    msg = "Script didn't run."
    boundpts = None
    number = None


    if not os.path.isdir(anaconda_path):
        user_name = getpass.getuser()
        anaconda_path = "C:\\Users\\{}\\AppData\\Local\\Continuum\\miniconda2\\".format(user_name)

    if not os.path.isdir(anaconda_path):
        where_path = "Cannot find path to mininaconda at {}.".format(anaconda_path)
        raise Exception( where_path +
                        " It is usually found in C:\Users\%USERNAME%\AppData\Local\Continuum\miniconda2. "
                        "Try inputting it manually")


    # Find/make all these
    program = os.path.join(anaconda_path, "python.exe")
    pkg_name = "Gradingtool"
    pkg_url = "https://github.com/saeranv/{}/archive/master.zip".format(pkg_name)
    
    cache_dir_parent = os.path.join(anaconda_path, "pkgs")
    cache_gh_pklname = "listen_app.pkl"
    cache_app_pklname = "listen_gh.pkl"
    
    package_path = set_directory_structure(update_tool, cache_dir_parent, pkg_name, pkg_url)
    pkg_cache_dir = os.path.join(package_path, "cache")
    
    
    # Pickle Grasshopper geometry

    bldg_crvpts = rvt2py(bldg_crv)
    topo_crvpts = rvt2py(topo_crv)
    topo_pts = [rvt2py(pt) for pt in topo_pts]

    msg = bldg_crvpts
    D = {}
    D["note"] = "testing from dynamo"
    D["curves"] = bldg_crvpts
    D["points"] = topo_pts
    D["topocrvs"] = topo_crvpts
    D["perpendicular_dist"] = perpendicular_dist
    D["spacing_dist"] = spacing_dist

    cachefpath = pickle(D, pkg_cache_dir, cache_gh_pklname)

    # Run run.py
    argument = os.path.join(package_path, pkg_name.lower(), "run.py")
    working_directory = package_path

    p, std_out, exit_code = run_python_process(p, program, argument, working_directory)
    msg = std_out

    # hack
    if exit_code != 0:
        # hack
        program_anaconda = os.path.join(anaconda_path.replace("miniconda2", "Anaconda2"), "python.exe")
        p, std_out, exit_code = run_python_process(p, program_anaconda, argument, working_directory)
        msg = std_out

    if exit_code != 0:
        return p, None, None, msg

    pkl_file = os.path.join(pkg_cache_dir, cache_app_pklname)
    D = unpickle(pkl_file)
    boundpts = D["closepts"]
    number = D["number"]
    #boundpts = [xyz.ToXyz()for xyz in py2rvt(boundpts)]
    boundpts = py2rvt(boundpts)


    return p, boundpts, number, msg

# Rename inputs
update_ = False
anaconda_path_ = ""
_run = IN[0]
_topo_pts = IN[1]
_topo_crv = IN[2]
_bldg_crv = IN[3]
_perp_dist = IN[4]
_space_dist = IN[5]

p = None

if _run:
    result = main(p, _topo_pts, _topo_crv, _bldg_crv, anaconda_path_, _perp_dist, _space_dist, update_tool = update_)
    p, boundpts, grade_avg, msg = result

    OUT = [msg, grade_avg, boundpts]
else:
    if p!=None:
        p.kill()
# ----------------------------------------
watch = Watch(gradingtool)
mesh = Topography.Mesh(topography=TOPO)
firstItem = List.FirstItem(list=perimeterCurves_2)
number_slider = DoubleSlider(3, range=0..100 step 0.1)
removeItemAtIndex = List.RemoveItemAtIndex(list=firstItem, indices=number_slider)
watch_2 = Watch(removeItemAtIndex)
watch_3 = Watch(perimeterCurves_2)
integer_slider = IntegerSlider(2, range=0..2 step 1)
getItemAtIndex = List.GetItemAtIndex(list=gradingtool, index=integer_slider)
python = Python(IN[0]=getItemAtIndex)
# ---------- python.python (14 lines) ----------
# Enable Python support and load DesignScript library
import clr
clr.AddReference('ProtoGeometry')
from Autodesk.DesignScript.Geometry import *

# The inputs to this node will be stored as a list in the IN variables.
X,Y,Z = [],[],[]

for pt in IN[0]:
	X.append(pt.X)
	Y.append(pt.Y)
	Z.append(pt.Z)

OUT = [X,Y,Z]
# ----------------------------------------
integer_slider_2 = IntegerSlider(0, range=0..2 step 1)
getItemAtIndex_2 = List.GetItemAtIndex(list=python, index=integer_slider_2)
integer_slider_3 = IntegerSlider(1, range=0..2 step 1)
getItemAtIndex_3 = List.GetItemAtIndex(list=python, index=integer_slider_3)
integer_slider_4 = IntegerSlider(2, range=0..2 step 1)
getItemAtIndex_4 = List.GetItemAtIndex(list=python, index=integer_slider_4)
byCoordinates = Point.ByCoordinates(x=getItemAtIndex_2, y=getItemAtIndex_3, z=getItemAtIndex_4)
byPoints = Polygon.ByPoints(points=byCoordinates)
boolean = BoolSelector(true)
conda_path = StringInput("\"\"")
updater = Python(IN[0]=boolean, IN[1]=conda_path)
# ---------- updater.python (163 lines) ----------
# Enable Python support and load DesignScript library
import clr
clr.AddReference('ProtoGeometry')
from Autodesk.DesignScript.Geometry import *
clr.AddReference('RevitAPI') #import clr
from Autodesk.Revit.DB import *

import sys
reload(sys)
sys.setdefaultencoding('utf-8')
sys.path.append(r"C:\Program Files (x86)\IronPython 2.7\Lib")
sys.path = sorted(sys.path, key=lambda p: p.find("Python27"))

import math
import uuid
import cPickle
import zipfile
import os
import subprocess
import getpass
import System

try:
    System.Net.ServicePointManager.SecurityProtocol = System.Net.SecurityProtocolType.Tls12
except AttributeError:
    # TLS 1.2 not provided by MacOS .NET Core; revert to using TLS 1.0
    System.Net.ServicePointManager.SecurityProtocol = System.Net.SecurityProtocolType.Tls



def download_file(url, targetDirectory):
    localFilePath = os.path.join(targetDirectory, os.path.basename(url))
    client = System.Net.WebClient()
    client.DownloadFile(url, localFilePath)
    return localFilePath

def check_or_make_directory(dir_path):
    if not os.path.isdir(dir_path):
        try:
            os.mkdir(dir_path)
        except:
            raise Exception("Folder can't be constructed: '{}' can't be made.".format(dir_path))

def unzip_file(zipFile, targetDirectory):
    #unzip the file
    with zipfile.ZipFile(zipFile) as zf:
        for f in zf.namelist():
            if f.endswith('/'):
                try: os.makedirs(f)
                except: pass
            else:
                zf.extract(f, targetDirectory)

def del_directory(dir, rmdir = True):
    try:
        if dir[-1] == os.sep: dir = dir[:-1]
        files = os.listdir(dir)
        for file in files:
            if file == '.' or file == '..': continue
            path = dir + os.sep + file
            if os.path.isdir(path):
                del_directory(path)
            else:
                os.unlink(path)
        if rmdir: os.rmdir(dir)
    except:
        print "Delete old directory failed"


def set_directory_structure(update_tool, cache_dir_parent, pkg_name, url):
    """
    Makes directory to store cache files if it doesn't exist.
    Copies python package over from git.
    """

    # cache directory
    cache_dir = r"kt_cpython_cache"
    cache_path = os.path.join(cache_dir_parent, cache_dir)

    # pkg directory
    pkg_parent_path = os.path.join(cache_path, pkg_name)
    pkg_path = os.path.join(pkg_parent_path, pkg_name + "-master")


    # if package exists
    if os.path.isdir(pkg_path):
        # delete pkg_path if you want to update
        if update_tool == True:
            del_directory(pkg_parent_path, rmdir = True)
            print "Deleting ", pkg_path

    # Check again if package doesn't exists, download from repo
    if not os.path.isdir(pkg_path):
            # cache directory
            check_or_make_directory(cache_path)
            # pacakge parent directory
            check_or_make_directory(pkg_parent_path)

            # download pkg zip
            zip_file_path = download_file(url, pkg_parent_path)
            print "Downloading the source code..."

            # unzip pkg
            unzip_file(zip_file_path, pkg_parent_path)

            print "Downloaded!"

    #run_bat_file(pkg_path)

    return pkg_path

def run_bat_file(directory = "C:/"):
    directory = 'C:/'
    batfpath = os.path.join(directory, 'python_packages.bat')
    with open(batfpath, 'w') as OPATH:
        OPATH.writelines(['conda install numpy\n','y\n','pause'])

    run_python_process(batfpath, directory)


def run_python_process(p, program, working_directory, argument = "", argstr = ""):
    #print program
    #print argument
    #print working_directory
    PIPE = subprocess.PIPE
    STDOUT = subprocess.STDOUT
    p = subprocess.Popen([program, argument, argstr], cwd=working_directory, shell=True, stdin=PIPE, stdout=PIPE, stderr=STDOUT)
    #print p.communicate()
    script_output = p.stdout.read()
    print script_output


def main(anaconda_path, update_tool = False):
    if anaconda_path is None:
        user_name = getpass.getuser()
        anaconda_path = "C:\\Users\\{}\\AppData\\Local\\Continuum\\miniconda2\\".format(user_name)

    if not os.path.isdir(anaconda_path):
        raise Exception("Cannot find path to Anaconda. It is usually found in C:\Users\%USERNAME%\AppData\Local\Continuum\miniconda2. Try inputting it manually")
        return

    # Find/make all these
    program = os.path.join(anaconda_path, "python.exe")
    pkg_name = "Gradingtool"
    pkg_url = "https://github.com/saeranv/{}/archive/master.zip".format(pkg_name)

    cache_dir_parent = os.path.join(anaconda_path, "pkgs")
    cache_gh_pklname = "listen_app.pkl"
    cache_app_pklname = "listen_gh.pkl"

    package_path = set_directory_structure(update_tool, cache_dir_parent, pkg_name, pkg_url)
    pkg_cache_dir = os.path.join(package_path, "cache")


    return 'Success'

anaconda_path_ = IN[1]
update_ = IN[0]

if IN[0] == True:
    if anaconda_path_ == "": anaconda_path_ = None
    result = main(None, update_tool = update_)
    OUT = result
# ----------------------------------------
watch_4 = Watch(updater)
integer_slider_5 = IntegerSlider(1, range=0..2 step 1)
getItemAtIndex_5 = List.GetItemAtIndex(list=gradingtool, index=integer_slider_5)
baseDist = DoubleInput(0)
python_script = Python(IN[0]=getItemAtIndex_5, IN[1]=baseDist)
# ---------- python_script.python (8 lines) ----------
# Enable Python support and load DesignScript library
import clr
clr.AddReference('ProtoGeometry')
from Autodesk.DesignScript.Geometry import *

# The inputs to this node will be stored as a list in the IN variables.
num = IN[0]
OUT = round((num/1000.0) - IN[1], 2)
# ----------------------------------------
grade_plane_average_weighted = Watch(python_script)  # "Grade Plane Average - Weighted Average from Dynamo"
lowest_point = Python(IN[0]=byCoordinates)
# ---------- lowest_point.python (7 lines) ----------
# Enable Python support and load DesignScript library
import clr
clr.AddReference('ProtoGeometry')
from Autodesk.DesignScript.Geometry import *
pts = IN[0]
zlst = [pt.Z for pt in pts]
OUT = sorted(zlst)[0]/1000.0
# ----------------------------------------
add_ref_height_for_sea_level = CodeBlock { 117.23; }  # "Add ref height for sea level here"
python_script_2 = Python(IN[0]=grade_plane_average_weighted, IN[1]=lowest_point, IN[2]=add_ref_height_for_sea_level)
# ---------- python_script_2.python (11 lines) ----------
# Enable Python support and load DesignScript library
import clr
clr.AddReference('ProtoGeometry')
from Autodesk.DesignScript.Geometry import *

L = []
LOWPTZ = IN[1]
REFHT = IN[2]
gpa = IN[0]

OUT = (gpa - LOWPTZ + REFHT)
# ----------------------------------------
grade_plane_average_weighted_2 = Watch(python_script_2)  # "Grade Plane Average - Weighted Average - with Revit Heights"
watch_5 = Custom[Springs.Watch+](input=gradingtool)  # This node that serializes the input information and presents it in a resizable text window.
python_script_3 = Python(IN[0]=getItemAtIndex_4, IN[1]=lowest_point, IN[2]=add_ref_height_for_sea_level)
# ---------- python_script_3.python (12 lines) ----------
# Enable Python support and load DesignScript library
import clr
clr.AddReference('ProtoGeometry')
from Autodesk.DesignScript.Geometry import *

# The inputs to this node will be stored as a list in the IN variables.
dataEnteringNode = IN

# Place your code below this line

# Assign your output to the OUT variable.
OUT = [x/1000.0 - IN[1] + IN[2] for x in IN[0]]
# ----------------------------------------
average = Math.Average(numbers=python_script_3)
watch_6 = Watch(average)
boolean_2 = BoolSelector(false)
watch_7 = Custom[Springs.Watch+](input=python_script_3, addIndexes=boolean_2)
