# Dynamo graph Average_Grade_Plane_Calculation_FOR_SCRIPTING_4.dyn (Dynamo 2.0.2.6826)

run = BoolSelector(true)

# group: Extract Points from Landscape Mesh
categories = Categories(index=208)
levels = Levels(index=4)
byCategoryAndLevel = archilab.Revit.Selection.Select.ByCategoryAndLevel(category=categories, level=levels)
points = Floor.Points(floor=byCategoryAndLevel@L1)
flatten = List.Flatten(list=points)

# group: Select building base, and subdivide to get points.
select_face = DSFaceSelection()  # 1 picked in the model
perimeterCurves = Surface.PerimeterCurves(surface=select_face)
byJoinedCurves = PolyCurve.ByJoinedCurves(curves=perimeterCurves)
integer_slider = IntegerSlider(250, range=50..250 step 1)
pointsAtEqualSegmentLength = Curve.PointsAtEqualSegmentLength(curve=byJoinedCurves, divisions=integer_slider)
flatten_2 = List.Flatten(list=pointsAtEqualSegmentLength)

perpendicular_Distance = DoubleInput(55)
string = StringInput("C:\Users\631\AppData\Local\Continuum\miniconda3")
grading_tool = Python(IN[0]=run, IN[1]=flatten, IN[2]=flatten_2, IN[3]=perpendicular_Distance, IN[4]=string)
# ---------- grading_tool.python (229 lines) ----------
# Enable Python support and load DesignScript library
import clr
clr.AddReference('ProtoGeometry')
from Autodesk.DesignScript.Geometry import *
clr.AddReference('RevitAPI') #import clr
from Autodesk.Revit.DB import *

import sys
reload(sys)
sys.setdefaultencoding('utf-8')
sys.path.append(r"C:\Program Files (x86)\IronPython 2.7\Lib")
sys.path = sorted(sys.path, key=lambda p: p.find("Python27"))

import math
import uuid
import pickle
import zipfile
import os
import subprocess
import getpass
import System

try:
    System.Net.ServicePointManager.SecurityProtocol = System.Net.SecurityProtocolType.Tls12
except AttributeError:
    # TLS 1.2 not provided by MacOS .NET Core; revert to using TLS 1.0
    System.Net.ServicePointManager.SecurityProtocol = System.Net.SecurityProtocolType.Tls


def download_file(url, targetDirectory):
    print targetDirectory
    localFilePath = os.path.join(targetDirectory, os.path.basename(url))
    client = System.Net.WebClient()
    client.DownloadFile(url, localFilePath)
    return localFilePath

def check_or_make_directory(dir_path):
    if not os.path.isdir(dir_path):
        try:
            os.mkdir(dir_path)
        except:
            raise Exception("Folder can't be constructed: '{}' can't be made.".format(dir_path))

def unzip_file(zipFile, targetDirectory):
    with zipfile.ZipFile(zipFile) as zf:
        for f in zf.namelist():
            if f.endswith('/'):
                try: os.makedirs(f)
                except: pass
            else:
                zf.extract(f, targetDirectory)

def del_directory(dir, rmdir = True):
    try:
        if dir[-1] == os.sep: dir = dir[:-1]
        files = os.listdir(dir)
        for file in files:
            if file == '.' or file == '..': continue
            path = dir + os.sep + file
            if os.path.isdir(path):
                del_directory(path)
            else:
                os.unlink(path)
        if rmdir: os.rmdir(dir)
    except:
        print "Delete old directory failed"

def set_directory_structure(update_tool, cache_dir_parent, pkg_name, url):
    """
    Makes directory to store cache files if it doesn't exist.
    Copies python package over from git.
    """

    # cache directory
    cache_dir = r"kt_cpython_cache"
    cache_path = os.path.join(cache_dir_parent, cache_dir)

    # pkg directory
    pkg_parent_path = os.path.join(cache_path, pkg_name)
    pkg_path = os.path.join(pkg_parent_path, pkg_name + "-master")

    # if package exists
    return pkg_path

def run_python_process(p, program, argument, working_directory):
    argstr = ""
    print program
    print argument
    print working_directory
    PIPE = subprocess.PIPE
    STDOUT = subprocess.STDOUT
    p = subprocess.Popen([program, argument, argstr], cwd=working_directory, shell=True, stdin=PIPE, stdout=PIPE, stderr=STDOUT)
    #print p.communicate()
    script_output = p.stdout.read()
    streamdata = p.communicate()[0] # need this to make sure process has finished
    exitcode = p.returncode

    if exitcode != 0:
        print "Command failed with return code", exitcode

    #script_output = program + argument + working_directory

    return p, script_output, exitcode

def send_to_pickle(znames_, aval_dict_, apts_mtx_, exp_, param_, cache_dir_):

    exp_run_name = experiment_run_name(exp_, param_)

    for i,apts_in_zone in enumerate(apts_mtx_):

        for j,apt in enumerate(apts_in_zone):
            apt = rs.coerce3dpoint(apt)
            apts_mtx_[i][j] = [apt[0],apt[1],apt[2]]

    #print(apts_mtx_[-1])
    #print(len(apts_mtx_[-1]))

    pkl_mtx = [znames_, apts_mtx_, aval_dict_]

    return pickle(pkl_mtx, cache_dir_, exp_run_name + ".pkl")

def pickledata(data, cpickle_path, cpickle_name):
    pkl_file_path = os.path.join(cpickle_path, cpickle_name)

    # Pickle objects, protocol 1 b/c binary file
    with open(pkl_file_path, "wb") as outf:
        pickle.dump(data, outf)

    return pkl_file_path

def unpickledata(pkl_file_path):
    """ Read non-binary picle """
    with open(pkl_file_path, "rb") as inf:
        unpickled_object = pickle.load(inf)
        return unpickled_object

def rvt2py(rhpt):
    if isinstance(rhpt, (list,tuple)):
        rhpt_lst = rhpt
        return [(rhpt.X, rhpt.Y, rhpt.Z) for rhpt in rhpt_lst]
    else:
        return (rhpt.X, rhpt.Y, rhpt.Z)

def py2rvt(pypt):
    if isinstance(pypt, (list,tuple)):
        pypt_lst = pypt
        return [XYZ(pypt[0],pypt[1],pypt[2]) for pypt in pypt_lst]
    else:
        return XYZ(pypt[0],pypt[1],pypt[2])


def main(p, topo_pts, bldg_crv, anaconda_path, perpendicular_dist, update_tool = False):
    msg = "Script didn't run."
    boundpts = None
    number = None

    if not os.path.isdir(anaconda_path):
        where_path = "Cannot find path to mininaconda at {}.".format(anaconda_path)
        raise Exception( where_path +
                        " It is usually found in C:\Users\%USERNAME%\AppData\Local\Continuum\miniconda2. "
                        "Try inputting it manually")


    # Find/make all these
    program = os.path.join(anaconda_path, "python.exe")
    pkg_name = "Gradingtool"
    pkg_url = "https://github.com/saeranv/{}/archive/master.zip".format(pkg_name)

    cache_dir_parent = os.path.join(anaconda_path, "pkgs")
    cache_gh_pklname = "listen_app.pkl"
    cache_app_pklname = "listen_gh.pkl"

    package_path = set_directory_structure(update_tool, cache_dir_parent, pkg_name, pkg_url)
    pkg_cache_dir = os.path.join(package_path, "cache")


    # Pickle Grasshopper geometry
		
    bldg_crvpts = rvt2py(bldg_crv)
    topo_pts = [rvt2py(pt) for pt in topo_pts]

    msg = bldg_crvpts
    D = {}
    D["note"] = "testing from dynamo"
    D["curves"] = bldg_crvpts
    D["points"] = topo_pts
    D["perpendicular_dist"] = perpendicular_dist

    cachefpath = pickledata(D, pkg_cache_dir, cache_gh_pklname)

    # Run run.py
    argument = os.path.join(package_path, pkg_name.lower(), "run.py")
    working_directory = package_path

    p, std_out, exit_code = run_python_process(p, program, argument, working_directory)
    msg = std_out

    if exit_code != 0:
        return p, None, None, msg

    pkl_file = os.path.join(pkg_cache_dir, cache_app_pklname)
    D = unpickledata(pkl_file)
    boundpts = D["closepts"]
    number = D["number"]
    #boundpts = [xyz.ToXyz()for xyz in py2rvt(boundpts)]
    boundpts = py2rvt(boundpts)


    return p, boundpts, number, msg

# Rename inputs
update_ = False

_run = IN[0]
_topo_pts = IN[1]
_bldg_crv = IN[2]
_perp_dist = IN[3]
anaconda_path_ = IN[4]

p = None

if _run:
    result = main(p, _topo_pts,_bldg_crv, anaconda_path_, _perp_dist, update_tool = update_)
    p, boundpts, grade_avg, msg = result

    OUT = [msg, grade_avg, boundpts]
else:
    if p!=None:
        p.kill()
# ----------------------------------------
integer_slider_2 = IntegerSlider(2, range=0..2 step 1)
getItemAtIndex = List.GetItemAtIndex(list=grading_tool, index=integer_slider_2)
python = Python(IN[0]=getItemAtIndex)
# ---------- python.python (21 lines) ----------
# Enable Python support and load DesignScript library
import clr
clr.AddReference("RevitNodes")
clr.AddReference('ProtoGeometry')
clr.AddReference('RevitAPI') 
clr.AddReference('RevitAPIUI')
import Revit
clr.ImportExtensions(Revit.GeometryConversion)
from Autodesk.DesignScript.Geometry import *
from Autodesk.Revit.DB import * 
# The inputs to this node will be stored as a list in the IN variables.
X,Y,Z = [],[],[]

for pt in IN[0]:
	X.append(pt.X)
	Y.append(pt.Y)
	Z.append(pt.Z)
	#xyz = XYZ(pt.X,pt.Y,pt.Z)
	#OUT.append(xyz.ToPoint())
	
OUT = [X,Y,Z]
# ----------------------------------------
integer_slider_3 = IntegerSlider(0, range=0..100 step 1)
getItemAtIndex_2 = List.GetItemAtIndex(list=python, index=integer_slider_3)
integer_slider_4 = IntegerSlider(1, range=0..100 step 1)
getItemAtIndex_3 = List.GetItemAtIndex(list=python, index=integer_slider_4)
integer_slider_5 = IntegerSlider(2, range=0..100 step 1)
getItemAtIndex_4 = List.GetItemAtIndex(list=python, index=integer_slider_5)
byCoordinates = Point.ByCoordinates(x=getItemAtIndex_2, y=getItemAtIndex_3, z=getItemAtIndex_4)
boolean = BoolSelector(false)
updater = Python(IN[0]=boolean, IN[1]=string)  # frozen
# ---------- updater.python (159 lines) ----------
# Enable Python support and load DesignScript library
import clr
clr.AddReference('ProtoGeometry')
from Autodesk.DesignScript.Geometry import *
clr.AddReference('RevitAPI') #import clr
from Autodesk.Revit.DB import *

import sys
reload(sys)
sys.setdefaultencoding('utf-8')
sys.path.append(r"C:\Program Files (x86)\IronPython 2.7\Lib")
sys.path = sorted(sys.path, key=lambda p: p.find("Python27"))

import math
import uuid
import cPickle
import zipfile
import os
import subprocess
import getpass
import System

try:
    System.Net.ServicePointManager.SecurityProtocol = System.Net.SecurityProtocolType.Tls12
except AttributeError:
    # TLS 1.2 not provided by MacOS .NET Core; revert to using TLS 1.0
    System.Net.ServicePointManager.SecurityProtocol = System.Net.SecurityProtocolType.Tls



def download_file(url, targetDirectory):
    localFilePath = os.path.join(targetDirectory, os.path.basename(url))
    client = System.Net.WebClient()
    client.DownloadFile(url, localFilePath)
    return localFilePath

def check_or_make_directory(dir_path):
    if not os.path.isdir(dir_path):
        try:
            os.mkdir(dir_path)
        except:
            raise Exception("Folder can't be constructed: '{}' can't be made.".format(dir_path))

def unzip_file(zipFile, targetDirectory):
    #unzip the file
    with zipfile.ZipFile(zipFile) as zf:
        for f in zf.namelist():
            if f.endswith('/'):
                try: os.makedirs(f)
                except: pass
            else:
                zf.extract(f, targetDirectory)

def del_directory(dir, rmdir = True):
    try:
        if dir[-1] == os.sep: dir = dir[:-1]
        files = os.listdir(dir)
        for file in files:
            if file == '.' or file == '..': continue
            path = dir + os.sep + file
            if os.path.isdir(path):
                del_directory(path)
            else:
                os.unlink(path)
        if rmdir: os.rmdir(dir)
    except:
        print "Delete old directory failed"


def set_directory_structure(update_tool, cache_dir_parent, pkg_name, url):
    """
    Makes directory to store cache files if it doesn't exist.
    Copies python package over from git.
    """

    # cache directory
    cache_dir = r"kt_cpython_cache"
    cache_path = os.path.join(cache_dir_parent, cache_dir)

    # pkg directory
    pkg_parent_path = os.path.join(cache_path, pkg_name)
    pkg_path = os.path.join(pkg_parent_path, pkg_name + "-master")


    # if package exists
    if os.path.isdir(pkg_path):
        # delete pkg_path if you want to update
        if update_tool == True:
            del_directory(pkg_parent_path, rmdir = True)
            print "Deleting ", pkg_path

    # Check again if package doesn't exists, download from repo
    if not os.path.isdir(pkg_path):
            # cache directory
            check_or_make_directory(cache_path)
            # pacakge parent directory
            check_or_make_directory(pkg_parent_path)

            # download pkg zip
            zip_file_path = download_file(url, pkg_parent_path)
            print "Downloading the source code..."

            # unzip pkg
            unzip_file(zip_file_path, pkg_parent_path)

            print "Downloaded!"

    #run_bat_file(pkg_path)

    return pkg_path

def run_bat_file(directory = "C:/"):
    directory = 'C:/'
    batfpath = os.path.join(directory, 'python_packages.bat')
    with open(batfpath, 'w') as OPATH:
        OPATH.writelines(['conda install numpy\n','y\n','pause'])

    run_python_process(batfpath, directory)


def run_python_process(p, program, working_directory, argument = "", argstr = ""):
    #print program
    #print argument
    #print working_directory
    PIPE = subprocess.PIPE
    STDOUT = subprocess.STDOUT
    p = subprocess.Popen([program, argument, argstr], cwd=working_directory, shell=True, stdin=PIPE, stdout=PIPE, stderr=STDOUT)
    #print p.communicate()
    script_output = p.stdout.read()
    print script_output


def main(anaconda_path, update_tool = False):
    
    if not os.path.isdir(anaconda_path):
        raise Exception("Cannot find path to Anacondaat:" + str(anaconda_path))
        return

    # Find/make all these
    program = os.path.join(anaconda_path, "python.exe")
    pkg_name = "Gradingtool"
    pkg_url = "https://github.com/saeranv/{}/archive/master.zip".format(pkg_name)

    cache_dir_parent = os.path.join(anaconda_path, "pkgs")
    cache_gh_pklname = "listen_app.pkl"
    cache_app_pklname = "listen_gh.pkl"

    package_path = set_directory_structure(update_tool, cache_dir_parent, pkg_name, pkg_url)
    pkg_cache_dir = os.path.join(package_path, "cache")


    return 'Success'

anaconda_path_ = IN[1]
update_ = IN[0]

if IN[0] == True:
    result = main(anaconda_path_, update_tool = update_)
    OUT = result
# ----------------------------------------
watch = Watch(updater)
watch_2 = Custom[Springs.Watch+](input=grading_tool)  # frozen; This node that serializes the input information and presents it in a resizable text window.
watch_3 = Watch(grading_tool)  # frozen

# group: Subtract from sea level height.
levels_2 = Levels(index=4)
projectElevation = Level.ProjectElevation(level=levels_2)
sub = getItemAtIndex_4 - projectElevation
number = DoubleInput(1000)
div = sub / number

# group: GPA = Average of height
average = Math.Average(numbers=div)
watch_4 = Watch(average)
